# Grasshopper definition test.gh (Grasshopper 1.0.7)

pt = ConstructPoint(XCoordinate=Slider(5, range=0..10), YCoordinate=Slider(2, range=0..10), ZCoordinate=Slider(1, range=0..10))
pt_2 = ConstructPoint(XCoordinate=Slider(2, range=0..10), YCoordinate=Slider(3, range=0..10), ZCoordinate=Slider(1, range=0..10))
panel = Panel("[7.473957026338122, 0.5111157458780888, 0.5187387096894881]")
pl = PlaneNormal(Origin=pt, ZAxis=pt_2)
pt_3 = ConstructPoint(XCoordinate=Slider(7.47, range=0..10), YCoordinate=Slider(0.51, range=0..10), ZCoordinate=Slider(0.52, range=0..10))
vdis = VectorDisplay(Anchor=pt, Vector=pt_3)
